# Grasshopper definition main.gh (Grasshopper 1.0.7)
# plug-ins: Human UI, DynaModel_v2

# ---- group: Transitional Motion
button = CreateButton(ButtonName="Transitional Motion", ButtonStyle=0)
adjustpos = AdjustElementPositioning(ElementsToAdjust=button, Margin=Slider(20, range=0..100), AbsolutePositioning=False, Width=Slider(140, range=0..200))

# ----
saved = SavedItems()
panel = Panel(saved)
button_2 = CreateButton(ButtonName="Delete All", ButtonStyle=0)
adjustpos_2 = AdjustElementPositioning(ElementsToAdjust=button_2, AbsolutePositioning=False, Width=Slider(75, range=0..100), Height=Slider(29, range=0..100))
listbox = CreateListBox(ListItems=flatten(panel), SelectedIndex=0, Height=100)
label = CreateLabel(LabelText="Saved Items", LabelSize=12, Justification=0)
values = ValueListener(Elements=button_2, SomeProperty=True)  # -> Values, Indices
values_2 = ValueListener(Elements=listbox, SomeProperty=True)  # -> Values, Indices
merge = Merge(Data1=label, Data2=listbox, Data3=button_2)  # -> flatten(Result)
panel_2 = Panel(values.Values)
deleteitem = DeleteItem(DeleteButton=values.Values, Item=values_2.Values)
panel_3 = Panel(values_2.Values)
viewbox = CreateViewBox(UIElements=merge, Width=Slider(80, range=0..1000), Height=Slider(200, range=0..1000))
separator = CreateSeparator(Thickness=0.5, Horizontal=True, Color=RGB(0, 0, 0))
button_3 = CreateButton(ButtonName="Generate All", ButtonStyle=0)
button_4 = CreateButton(ButtonName="Cancel", ButtonStyle=0)
button_5 = CreateButton(ButtonName="Create model for 3D printer", ButtonStyle=0)
launchwin = LaunchWindow(
    Show=Toggle(True),
    Name="DynaModel",
    Width=Slider(380, range=0..1000),
    Height=400,
    ChildStatus=0,
    EnableHorizScroll=False)

# ---- group: Temperatu
separator_2 = CreateSeparator(Thickness=0.5, Horizontal=True, Color=RGB(0, 0, 0))
button_6 = CreateButton(ButtonName="Save", ButtonStyle=0)
button_7 = CreateButton(ButtonName="Clear", ButtonStyle=0)
true_button = CreateTrueOnlyButton(ButtonName="Voice", ButtonStyle=0)
tb = CreateTextBlock(Text="Step 1: Press the button to create", TextSize=12, Justification=0)
adjustpos_3 = AdjustElementPositioning(
    ElementsToAdjust=true_button,
    Margin=Slider(20, range=0..100),
    AbsolutePositioning=False,
    Width=Slider(140, range=0..1000))
merge_2 = Merge(Data1=button_6, Data2=button_7)
button_8 = CreateButton(ButtonName="Create", ButtonStyle=0)
values_3 = ValueListener(Elements=true_button, SomeProperty=True)  # -> Values, Indices
stack = CreateStack(UIElements=merge_2, Horizontal=True)
adjustpos_4 = AdjustElementPositioning(
    ElementsToAdjust=button_7,
    Margin=Slider(20, range=0..100),
    AbsolutePositioning=False,
    Width=Slider(140, range=0..1000),
    Height=Slider(30, range=0..100))
adjustpos_5 = AdjustElementPositioning(
    ElementsToAdjust=button_6,
    Margin=Slider(20, range=0..100),
    AbsolutePositioning=False,
    Width=Slider(140, range=0..1000),
    Height=Slider(30, range=0..100))
merge_3 = Merge(Data4=tb, Data5=button_8, Data6=separator_2, Data7=stack)
launchwin_2 = LaunchWindow(Show=values_3.Values, Name="Voice", Width=370, Height=400, ChildStatus=0, EnableHorizScroll=False)
childwin = MakeChildWindow(ParentWindow=launchwin, ChildWindow=launchwin_2)
addelems = AddElements(Window=launchwin_2, Elements=flatten(merge_3), DoVLChecking=True)  # -> AddedElements, ElementNames

# ---- group: Vibration
separator_3 = CreateSeparator(Thickness=0.5, Horizontal=True, Color=RGB(0, 0, 0))
button_9 = CreateButton(ButtonName="Save", ButtonStyle=0)
button_10 = CreateButton(ButtonName="Clear", ButtonStyle=0)
true_button_2 = CreateTrueOnlyButton(ButtonName="Vibration", ButtonStyle=0)
tb_2 = CreateTextBlock(Text="Step 1: Press the button to create", TextSize=12, Justification=0)
adjustpos_6 = AdjustElementPositioning(
    ElementsToAdjust=true_button_2,
    Margin=Slider(20, range=0..100),
    AbsolutePositioning=False,
    Width=Slider(140, range=0..1000))
merge_4 = Merge(Data1=button_9, Data2=button_10)
button_11 = CreateButton(ButtonName="Create", ButtonStyle=0)
values_4 = ValueListener(Elements=true_button_2, SomeProperty=True)  # -> Values, Indices
stack_2 = CreateStack(UIElements=merge_4, Horizontal=True)
adjustpos_7 = AdjustElementPositioning(
    ElementsToAdjust=button_10,
    Margin=Slider(20, range=0..100),
    AbsolutePositioning=False,
    Width=Slider(140, range=0..1000),
    Height=Slider(30, range=0..100))
adjustpos_8 = AdjustElementPositioning(
    ElementsToAdjust=button_9,
    Margin=Slider(20, range=0..100),
    AbsolutePositioning=False,
    Width=Slider(140, range=0..1000),
    Height=Slider(30, range=0..100))
merge_5 = Merge(Data4=tb_2, Data5=button_11, Data6=separator_3, Data7=stack_2)
launchwin_3 = LaunchWindow(Show=values_4.Values, Name="Vibration", Width=370, Height=400, ChildStatus=0, EnableHorizScroll=False)
childwin_2 = MakeChildWindow(ParentWindow=launchwin, ChildWindow=launchwin_3)
addelems_2 = AddElements(Window=launchwin_3, Elements=flatten(merge_5), DoVLChecking=True)  # -> AddedElements, ElementNames

# ---- group: Touch
separator_4 = CreateSeparator(Thickness=0.5, Horizontal=True, Color=RGB(0, 0, 0))
button_12 = CreateButton(ButtonName="Save", ButtonStyle=0)
button_13 = CreateButton(ButtonName="Clear", ButtonStyle=0)
true_button_3 = CreateTrueOnlyButton(ButtonName="Touch", ButtonStyle=0)
tb_3 = CreateTextBlock(Text="Step 1: Press the button to create", TextSize=12, Justification=0)
adjustpos_9 = AdjustElementPositioning(
    ElementsToAdjust=true_button_3,
    Margin=Slider(20, range=0..100),
    AbsolutePositioning=False,
    Width=Slider(140, range=0..1000))
merge_6 = Merge(Data1=button_12, Data2=button_13)
button_14 = CreateButton(ButtonName="Create", ButtonStyle=0)
values_5 = ValueListener(Elements=true_button_3, SomeProperty=True)  # -> Values, Indices
stack_3 = CreateStack(UIElements=merge_6, Horizontal=True)
adjustpos_10 = AdjustElementPositioning(
    ElementsToAdjust=button_13,
    Margin=Slider(20, range=0..100),
    AbsolutePositioning=False,
    Width=Slider(140, range=0..1000),
    Height=Slider(30, range=0..100))
adjustpos_11 = AdjustElementPositioning(
    ElementsToAdjust=button_12,
    Margin=Slider(20, range=0..100),
    AbsolutePositioning=False,
    Width=Slider(140, range=0..1000),
    Height=Slider(30, range=0..100))
merge_7 = Merge(Data4=tb_3, Data5=button_14, Data6=separator_4, Data7=stack_3)
launchwin_4 = LaunchWindow(Show=values_5.Values, Name="Touch", Width=370, Height=400, ChildStatus=0, EnableHorizScroll=False)
childwin_3 = MakeChildWindow(ParentWindow=launchwin, ChildWindow=launchwin_4)
addelems_3 = AddElements(Window=launchwin_4, Elements=flatten(merge_7), DoVLChecking=True)  # -> AddedElements, ElementNames

# ---- group: Button
separator_5 = CreateSeparator(Thickness=0.5, Horizontal=True, Color=RGB(0, 0, 0))
button_15 = CreateButton(ButtonName="Save", ButtonStyle=0)
button_16 = CreateButton(ButtonName="Clear", ButtonStyle=0)
true_button_4 = CreateTrueOnlyButton(ButtonName="Button", ButtonStyle=0)
tb_4 = CreateTextBlock(Text="Step 1: Press the button to create", TextSize=12, Justification=0)
adjustpos_12 = AdjustElementPositioning(
    ElementsToAdjust=true_button_4,
    Margin=Slider(20, range=0..100),
    AbsolutePositioning=False,
    Width=Slider(140, range=0..1000))
merge_8 = Merge(Data1=button_15, Data2=button_16)
button_17 = CreateButton(ButtonName="Create", ButtonStyle=0)
values_6 = ValueListener(Elements=true_button_4, SomeProperty=True)  # -> Values, Indices
stack_4 = CreateStack(UIElements=merge_8, Horizontal=True)
adjustpos_13 = AdjustElementPositioning(
    ElementsToAdjust=button_16,
    Margin=Slider(20, range=0..100),
    AbsolutePositioning=False,
    Width=Slider(140, range=0..1000),
    Height=Slider(30, range=0..100))
adjustpos_14 = AdjustElementPositioning(
    ElementsToAdjust=button_15,
    Margin=Slider(20, range=0..100),
    AbsolutePositioning=False,
    Width=Slider(140, range=0..1000),
    Height=Slider(30, range=0..100))
launchwin_5 = LaunchWindow(Show=values_6.Values, Name="Button", Width=370, Height=400, ChildStatus=0, EnableHorizScroll=False)
merge_9 = Merge(Data4=tb_4, Data5=button_17, Data6=separator_5, Data7=stack_4)
childwin_4 = MakeChildWindow(ParentWindow=launchwin, ChildWindow=launchwin_5)
addelems_4 = AddElements(Window=launchwin_5, Elements=flatten(merge_9), DoVLChecking=True)  # -> AddedElements, ElementNames

# ---- group: Swipe
button_18 = CreateButton(ButtonName="Save", ButtonStyle=0)
button_19 = CreateButton(ButtonName="Clear", ButtonStyle=0)
panel_4 = Panel("""Rotational Motion
LED Light
Vibration""")
panel_5 = Panel("Step 1: Decide what parameter that this Swipe parameter is designed for:")
merge_10 = Merge(Data1=button_18, Data2=button_19)
separator_6 = CreateSeparator(Thickness=0.5, Horizontal=True, Color=RGB(0, 0, 0))
separator_7 = CreateSeparator(Thickness=0.5, Horizontal=True, Color=RGB(0, 0, 0))
true_button_5 = CreateTrueOnlyButton(ButtonName="Swipe", ButtonStyle=0)
pulldown = CreatePulldownMenu(ListItems=panel_4, showLabel=True)
stack_5 = CreateStack(UIElements=merge_10, Horizontal=True)
adjustpos_15 = AdjustElementPositioning(
    ElementsToAdjust=button_19,
    Margin=Slider(20, range=0..100),
    AbsolutePositioning=False,
    Width=Slider(140, range=0..1000),
    Height=Slider(30, range=0..100))
tb_5 = CreateTextBlock(Text=panel_5, TextSize=12, Justification=0)
adjustpos_16 = AdjustElementPositioning(
    ElementsToAdjust=button_18,
    Margin=Slider(20, range=0..100),
    AbsolutePositioning=False,
    Width=Slider(140, range=0..1000),
    Height=Slider(30, range=0..100))
tb_6 = CreateTextBlock(Text="Step 2: Press the button to create", TextSize=12, Justification=0)
button_20 = CreateButton(ButtonName="Create", ButtonStyle=0)
adjustpos_17 = AdjustElementPositioning(
    ElementsToAdjust=true_button_5,
    Margin=Slider(20, range=0..100),
    AbsolutePositioning=False,
    Width=Slider(140, range=0..1000))
values_7 = ValueListener(Elements=true_button_5, SomeProperty=True)  # -> Values, Indices
launchwin_6 = LaunchWindow(Show=values_7.Values, Name="Swipe", Width=370, Height=400, ChildStatus=0, EnableHorizScroll=False)
merge_11 = Merge(Data1=tb_5, Data2=pulldown, Data3=separator_7, Data4=tb_6, Data5=button_20, Data6=separator_6, Data7=stack_5)
childwin_5 = MakeChildWindow(ParentWindow=launchwin, ChildWindow=launchwin_6)
addelems_5 = AddElements(Window=launchwin_6, Elements=flatten(merge_11), DoVLChecking=True)  # -> AddedElements, ElementNames

# ---- group: Light
pipe_radius_mm = Slider(3, range=1..6)
true_button_6 = CreateTrueOnlyButton(ButtonName="LED Light", ButtonStyle=0)
adjustpos_18 = AdjustElementPositioning(
    ElementsToAdjust=true_button_6,
    Margin=Slider(20, range=0..100),
    AbsolutePositioning=False,
    Width=Slider(140, range=0..1000))
values_8 = ValueListener(Elements=true_button_6, SomeProperty=True)  # -> Values, Indices
separator_8 = CreateSeparator(Thickness=0.5, Horizontal=True, Color=RGB(0, 0, 0))
separator_9 = CreateSeparator(Thickness=0.5, Horizontal=True, Color=RGB(0, 0, 0))
button_21 = CreateButton(ButtonName="Create", ButtonStyle=0)
tb_7 = CreateTextBlock(Text="Step 2: Design the light outsource and create", TextSize=12, Justification=0)
button_22 = CreateButton(ButtonName="Clear", ButtonStyle=0)
button_23 = CreateButton(ButtonName="Save", ButtonStyle=0)
slider = CreateSlider(Slider=pipe_radius_mm, ShowBounds=False, ShowTicks=False, ShowTooltip=False, ShowValLabel=True, showLabel=True)
adjustpos_19 = AdjustElementPositioning(
    ElementsToAdjust=button_22,
    Margin=Slider(20, range=0..100),
    AbsolutePositioning=False,
    Width=Slider(140, range=0..1000),
    Height=Slider(30, range=0..100))
adjustpos_20 = AdjustElementPositioning(
    ElementsToAdjust=button_23,
    Margin=Slider(20, range=0..100),
    AbsolutePositioning=False,
    Width=Slider(140, range=0..1000),
    Height=Slider(30, range=0..100))
tb_8 = CreateTextBlock(Text="Step 1: Decide the light pipe's parameters", TextSize=12, Justification=0)
label_2 = CreateLabel(LabelText="Inner Pipe Material:", LabelSize=12, Justification=0)
launchwin_7 = LaunchWindow(Show=values_8.Values, Name="LED Light", Width=370, Height=400, ChildStatus=0, EnableHorizScroll=False)
values_9 = ValueListener(Elements=button_21, SomeProperty=True)  # -> Values, Indices
values_10 = ValueListener(Elements=button_23, SomeProperty=True)  # -> Values, Indices
values_11 = ValueListener(Elements=button_22, SomeProperty=True)  # -> Values, Indices
radiobtn = CreateRadioButton(RadioButtonName="Conductive", RadioButtonGroup="Inner Pipe Material", InitiallySelected=Toggle(True))
radiobtn_2 = CreateRadioButton(RadioButtonName="Normal PVC", RadioButtonGroup="Inner Pipe Material", InitiallySelected=False)
merge_12 = Merge(Data1=button_23, Data2=button_22)  # -> flatten(Result)
childwin_6 = MakeChildWindow(ParentWindow=launchwin, ChildWindow=launchwin_7)
createpipe = CreatePipe(StartButton=values_9.Values, InputType="NA", OutputType="LED Light")
merge_13 = Merge(Data1=label_2, Data2=radiobtn, Data3=radiobtn_2)  # -> flatten(Result)
cancel = Cancel(CancelButton=values_11.Values)
save = Save(SaveButton=values_10.Values, Item=createpipe)
stack_6 = CreateStack(UIElements=merge_12, Horizontal=True)
stack_7 = CreateStack(UIElements=merge_13, Horizontal=True)
merge_14 = Merge(
    Data1=tb_8,
    Data2=slider,
    Data3=stack_7,
    Data4=separator_9,
    Data5=tb_7,
    Data6=button_21,
    Data7=separator_8,
    Data8=stack_6)
addelems_6 = AddElements(Window=launchwin_7, Elements=flatten(merge_14), DoVLChecking=True)  # -> AddedElements, ElementNames

# ---- group: Air Pipe
panel_6 = Panel("Air Pipe")
panel_7 = Panel("Step 1: Press the button to create a air pipe to detect humidity and temperature")
separator_10 = CreateSeparator(Thickness=0.5, Horizontal=True, Color=RGB(0, 0, 0))
true_button_7 = CreateTrueOnlyButton(ButtonName=panel_6, ButtonStyle=0)
button_24 = CreateButton(ButtonName="Save", ButtonStyle=0)
button_25 = CreateButton(ButtonName="Clear", ButtonStyle=0)
adjustpos_21 = AdjustElementPositioning(
    ElementsToAdjust=true_button_7,
    Margin=Slider(20, range=0..100),
    AbsolutePositioning=False,
    Width=Slider(140, range=0..1000))
button_26 = CreateButton(ButtonName="Create", ButtonStyle=0)
tb_9 = CreateTextBlock(Text=panel_7, TextSize=12, Justification=0)
values_12 = ValueListener(Elements=true_button_7, SomeProperty=True)  # -> Values, Indices
merge_15 = Merge(Data1=button_24, Data2=button_25)
launchwin_8 = LaunchWindow(Show=values_12.Values, Name=panel_6, Width=370, Height=400, ChildStatus=0, EnableHorizScroll=False)
stack_8 = CreateStack(UIElements=merge_15, Horizontal=True)
adjustpos_22 = AdjustElementPositioning(
    ElementsToAdjust=button_25,
    Margin=Slider(20, range=0..100),
    AbsolutePositioning=False,
    Width=Slider(140, range=0..1000),
    Height=Slider(30, range=0..100))
adjustpos_23 = AdjustElementPositioning(
    ElementsToAdjust=button_24,
    Margin=Slider(20, range=0..100),
    AbsolutePositioning=False,
    Width=Slider(140, range=0..1000),
    Height=Slider(30, range=0..100))
childwin_7 = MakeChildWindow(ParentWindow=launchwin, ChildWindow=launchwin_8)
merge_16 = Merge(Data1=tb_9, Data2=button_26, Data3=separator_10, Data4=stack_8)
addelems_7 = AddElements(Window=launchwin_8, Elements=flatten(merge_16), DoVLChecking=True)  # -> AddedElements, ElementNames

# ----
values_13 = ValueListener(Elements=button_14, SomeProperty=True)  # -> Values, Indices
values_14 = ValueListener(Elements=button_13, SomeProperty=True)  # -> Values, Indices
values_15 = ValueListener(Elements=button_12, SomeProperty=True)  # -> Values, Indices
values_16 = ValueListener(Elements=button_26, SomeProperty=True)  # -> Values, Indices
cancel_2 = Cancel(CancelButton=values_14.Values)
createsimpletouch = CreateSimpleTouch(StartButton=values_13.Values)
values_17 = ValueListener(Elements=button_17, SomeProperty=True)  # -> Values, Indices
values_18 = ValueListener(Elements=button_16, SomeProperty=True)  # -> Values, Indices
values_19 = ValueListener(Elements=button_15, SomeProperty=True)  # -> Values, Indices
createsimplepipe = CreateSimplePipe(StartButton=values_16.Values, InputType="NA", OutputType=panel_6)
values_20 = ValueListener(Elements=button_25, SomeProperty=True)  # -> Values, Indices
values_21 = ValueListener(Elements=button_24, SomeProperty=True)  # -> Values, Indices
save_2 = Save(SaveButton=values_15.Values, Item=createsimpletouch)
cancel_3 = Cancel(CancelButton=values_18.Values)
save_3 = Save(SaveButton=values_21.Values, Item=createsimplepipe)
cancel_4 = Cancel(CancelButton=values_20.Values)
createsimplebutton = CreateSimpleButton(StartButton=values_17.Values)
save_4 = Save(SaveButton=values_19.Values, Item=createsimplebutton)

# ---- group: Rotational
true_button_8 = CreateTrueOnlyButton(ButtonName="Rotational Motion", ButtonStyle=0)
adjustpos_24 = AdjustElementPositioning(
    ElementsToAdjust=true_button_8,
    Margin=Slider(20, range=0..100),
    AbsolutePositioning=False,
    Width=Slider(140, range=0..1000))
values_22 = ValueListener(Elements=true_button_8, SomeProperty=True)  # -> Values, Indices
launchwin_9 = LaunchWindow(Show=values_22.Values, Name="Rotational Motion", Width=370, Height=400, ChildStatus=0, EnableHorizScroll=False)
childwin_8 = MakeChildWindow(ParentWindow=launchwin, ChildWindow=launchwin_9)
thickness = Slider(1, range=0..2)
size = Slider(1, range=0..2)
panel_8 = Panel("Step 1: Create a cutter to cut the model into two part: main model and end effector")
separator_11 = CreateSeparator(Thickness=0.5, Horizontal=True, Color=RGB(0, 0, 0))
tb_10 = CreateTextBlock(Text="Step 2: Scale the cutter", TextSize=12, Justification=0)
slider_2 = CreateSlider(Slider=size, ShowBounds=False, ShowTicks=False, ShowTooltip=False, ShowValLabel=True, showLabel=True)
slider_3 = CreateSlider(Slider=thickness, ShowBounds=False, ShowTicks=False, ShowTooltip=False, ShowValLabel=True, showLabel=True)
button_27 = CreateButton(ButtonName="Clear", ButtonStyle=0)
separator_12 = CreateSeparator(Thickness=0.5, Horizontal=True, Color=RGB(0, 0, 0))
button_28 = CreateButton(ButtonName="Choose", ButtonStyle=0)
tb_11 = CreateTextBlock(Text="Step 3: Choose your end effector", TextSize=12, Justification=0)
tb_12 = CreateTextBlock(Text=panel_8, TextSize=12, Justification=0)
button_29 = CreateButton(ButtonName="Create Cutter", ButtonStyle=0)
separator_13 = CreateSeparator(Thickness=0.5, Horizontal=True, Color=RGB(0, 0, 0))
button_30 = CreateButton(ButtonName="Save", ButtonStyle=0)
adjustpos_25 = AdjustElementPositioning(
    ElementsToAdjust=button_30,
    Margin=Slider(20, range=0..100),
    AbsolutePositioning=False,
    Width=Slider(140, range=0..1000),
    Height=Slider(30, range=0..100))
adjustpos_26 = AdjustElementPositioning(
    ElementsToAdjust=button_27,
    Margin=Slider(20, range=0..100),
    AbsolutePositioning=False,
    Width=Slider(140, range=0..1000),
    Height=Slider(30, range=0..100))
values_23 = ValueListener(Elements=button_27, SomeProperty=True)  # -> Values, Indices
values_24 = ValueListener(Elements=slider_3, SomeProperty=True)  # -> Values, Indices
values_25 = ValueListener(Elements=slider_2, SomeProperty=True)  # -> Values, Indices
values_26 = ValueListener(Elements=button_30, SomeProperty=True)  # -> Values, Indices
values_27 = ValueListener(Elements=button_29, SomeProperty=True)  # -> Values, Indices
merge_17 = Merge(Data1=button_30, Data2=button_27)  # -> flatten(Result)
values_28 = ValueListener(Elements=button_28, SomeProperty=True)  # -> Values, Indices
tbvc = TrueButtonValueController(TrueButtonValue=values_27.Values)
cancel_5 = Cancel(CancelButton=values_23.Values)
stack_9 = CreateStack(UIElements=merge_17, Horizontal=Toggle(True))
cutter = CreateCutter(StartButton=tbvc)
scale = ScaleCutter(Essentials=cutter, ScaleFactor=values_25.Values, Thickness=values_24.Values)
radiobtn_3 = CreateRadioButton(RadioButtonName="Slow", RadioButtonGroup="Gear Speed Group", InitiallySelected=False)
radiobtn_4 = CreateRadioButton(RadioButtonName="Normal", RadioButtonGroup="Gear Speed Group", InitiallySelected=Toggle(True))
radiobtn_5 = CreateRadioButton(RadioButtonName="Fast", RadioButtonGroup="Gear Speed Group", InitiallySelected=False)
values_29 = ValueListener(Elements=radiobtn_4, SomeProperty=True)  # -> Values, Indices
values_30 = ValueListener(Elements=radiobtn_3, SomeProperty=True)  # -> Values, Indices
values_31 = ValueListener(Elements=radiobtn_5, SomeProperty=True)  # -> Values, Indices
radiolistener = RadioButtonListener(Slow=values_30.Values, Normal=values_29.Values, Fast=values_31.Values)
endeffector = ChooseEndEffector(Button=values_28.Values, Essentials=scale, GearSpeed=radiolistener)  # -> ResetButtonValue, SavedItem
save_5 = Save(SaveButton=values_26.Values, Item=endeffector.SavedItem)
merge_18 = Merge(Data1=radiobtn_3, Data2=radiobtn_4, Data3=radiobtn_5)  # -> flatten(Result)
stack_10 = CreateStack(UIElements=merge_18, Horizontal=True)
merge_19 = Merge(
    Data1=tb_12,
    Data2=button_29,
    Data3=separator_13,
    Data4=tb_10,
    Data5=slider_2,
    Data6=slider_3,
    Data7=separator_11,
    Data8=tb_11,
    Data9=stack_10,
    Data10=button_28,
    Data11=separator_12,
    Data12=stack_9)
addelems_8 = AddElements(Window=launchwin_9, Elements=flatten(merge_19), DoVLChecking=True)  # -> AddedElements, ElementNames

# ----
merge_20 = Merge(Data1=true_button_5, Data2=true_button_3)  # -> flatten(Result)
merge_21 = Merge(Data1=true_button)
merge_22 = Merge(Data1=true_button_4, Data2=true_button_2)  # -> flatten(Result)
stack_11 = CreateStack(UIElements=merge_20, Horizontal=Toggle(True))
stack_12 = CreateStack(UIElements=merge_22, Horizontal=Toggle(True))
stack_13 = CreateStack(UIElements=merge_21, Horizontal=Toggle(True))
merge_23 = Merge(Data1=true_button_6, Data2=true_button_7)  # -> flatten(Result)
merge_24 = Merge(Data1=true_button_8, Data2=button)  # -> flatten(Result)
stack_14 = CreateStack(UIElements=merge_23, Horizontal=Toggle(True))
stack_15 = CreateStack(UIElements=merge_24, Horizontal=Toggle(True))
merge_25 = Merge(Data1=stack_15, Data2=stack_14, Data3=stack_11, Data4=stack_12, Data5=stack_13)  # -> flatten(Result)
viewbox_2 = CreateViewBox(UIElements=merge_25, Width=Slider(279, range=0..1000), Height=Slider(292, range=0..1000))
merge_26 = Merge(Data1=viewbox, Data2=viewbox_2)  # -> flatten(Result)
stack_16 = CreateStack(UIElements=merge_26, Horizontal=True)
merge_27 = Merge(Data1=button_3, Data2=button_4)
stack_17 = CreateStack(UIElements=merge_27, Horizontal=True)
adjustpos_27 = AdjustElementPositioning(
    ElementsToAdjust=button_4,
    Margin=Slider(20, range=0..100),
    AbsolutePositioning=False,
    Width=Slider(140, range=0..1000),
    Height=Slider(30, range=0..100))
adjustpos_28 = AdjustElementPositioning(
    ElementsToAdjust=button_3,
    Margin=Slider(20, range=0..100),
    AbsolutePositioning=False,
    Width=Slider(140, range=0..1000),
    Height=Slider(30, range=0..100))
separator_14 = CreateSeparator(Thickness=0.5, Horizontal=True, Color=RGB(0, 0, 0))
values_32 = ValueListener(Elements=button_3, SomeProperty=True)  # -> Values, Indices
merge_28 = Merge(Data1=stack_16, Data2=separator_14, Data3=stack_17, Data4=separator, Data5=button_5)
addelems_9 = AddElements(Window=launchwin, Elements=flatten(merge_28), DoVLChecking=True)  # -> AddedElements, ElementNames
nickname = Generate(GenerateButton=values_32.Values)
